# Dynamo graph Home.dyn (Dynamo 2.1.0.7500)

code_block = CodeBlock { [0,0,0]; }
byCoordinates = Point.ByCoordinates(x=code_block, y=code_block, z=code_block)
code_block_2 = CodeBlock { 2; }
byCenterPointRadius = Circle.ByCenterPointRadius(centerPoint=byCoordinates, radius=code_block_2)
wall_types = WallTypes("Interior - Partition")
getCategory = Element.GetCategory(element=wall_types)
byGeometry = FamilyType.ByGeometry(solidGeometry=byCenterPointRadius, category=getCategory)  # unwired: name, templatePath, material
