# Dynamo graph Niveles y plantas_estación_01.dyn (Dynamo 2.1.0.7500)

# group: Coordenadas puntos
code_block = CodeBlock { [0,2.5,5]; }
code_block_2 = CodeBlock { 0; }
code_block_3 = CodeBlock { 100; }

list_create = List.Create(item0=code_block)

# group: Puntos
byCoordinates = Point.ByCoordinates(x=list_create, y=code_block_2, z=code_block_2)
byCoordinates_2 = Point.ByCoordinates(x=list_create, y=code_block_3, z=code_block_2)

# group: Puntos
byCoordinates_3 = Point.ByCoordinates(x=list_create, y=code_block_2, z=code_block_2)
byCoordinates_4 = Point.ByCoordinates(x=list_create, y=code_block_2, z=code_block_2)

# group: Puntos
byCoordinates_5 = Point.ByCoordinates(x=list_create, y=code_block_3, z=code_block_2)
byCoordinates_6 = Point.ByCoordinates(x=list_create, y=code_block_3, z=code_block_2)

# group: Líneas
byStartPointEndPoint = Line.ByStartPointEndPoint(startPoint=byCoordinates, endPoint=byCoordinates_2)
byStartPointEndPoint_2 = Line.ByStartPointEndPoint(startPoint=byCoordinates_3, endPoint=byCoordinates_4)
byStartPointEndPoint_3 = Line.ByStartPointEndPoint(startPoint=byCoordinates_5, endPoint=byCoordinates_6)

# group: Ejes
byLine = Grid.ByLine(line=byStartPointEndPoint)
byLine_2 = Grid.ByLine(line=byStartPointEndPoint_2)
byLine_3 = Grid.ByLine(line=byStartPointEndPoint_3)

# group: Coordenadas puntos X y Z
code_block_4 = CodeBlock { 0; }
code_block_5 = CodeBlock { 5; }

# group: Coordenada Y
code_block_6 = CodeBlock { 0; }
code_block_7 = CodeBlock { 100; }
code_block_8 = CodeBlock { 4; }
range = Range(start=code_block_6, end=code_block_7, step=code_block_8)
watch = Watch(range)  # graph output

# group: Puntos
byCoordinates_7 = Point.ByCoordinates(x=code_block_4, y=watch, z=code_block_4)
byCoordinates_8 = Point.ByCoordinates(x=code_block_5, y=watch, z=code_block_4)

# group: Líneas
byStartPointEndPoint_4 = Line.ByStartPointEndPoint(startPoint=byCoordinates_7, endPoint=byCoordinates_8)

# group: Ejes
byLine_4 = Grid.ByLine(line=byStartPointEndPoint_4)

# group: NIVELES ESTACIÓN
code_block_9 = CodeBlock { 4; }
code_block_10 = CodeBlock(altura=code_block_9) { "NPT_"+altura; }
byElevationAndName = Level.ByElevationAndName(elevation=code_block_9, name=code_block_10)
code_block_11 = CodeBlock { 0.2; }
code_block_12 = CodeBlock(altura=code_block_11) { "NPT_"+altura; }
byElevationAndName_2 = Level.ByElevationAndName(elevation=code_block_11, name=code_block_12)
code_block_13 = CodeBlock { 0; }
code_block_14 = CodeBlock(altura=code_block_13) { "NPT_"+altura; }
byElevationAndName_3 = Level.ByElevationAndName(elevation=code_block_13, name=code_block_14)
code_block_15 = CodeBlock { 4.7; }

code_block_16 = CodeBlock(altura=code_block_15) { "NPT_"+altura; }

# group (continued): NIVELES ESTACIÓN
byElevationAndName_4 = Level.ByElevationAndName(elevation=code_block_15, name=code_block_16)

byLevel = StructuralPlanView.ByLevel(level=byElevationAndName_4)
